# Grasshopper definition grasshopper_viktor_compute.gh (Grasshopper 1.0.8)
# plug-ins: RhinoCodePluginGH

load_kn_m = Slider(5, range=1..20)
length_m = Slider(15, range=1..30)
list = ValueList({"IPE80", "IPE100", "IPE120", "IPE140", "IPE160", "IPE180", "IPE200", "IPE220", "IPE240", "IPE270", "IPE300", "IPE330", "IPE360", "IPE400", "IPE450", "IPE500", "IPE550", "IPE600"}, selected="IPE400")
viktor_compute = Python3Script(url="https://demo.viktor.ai/workspaces/327/app/editor/7573", load=load_kn_m, length=length_m, profile=list)  # -> results
# ---------- viktor_compute: Python ----------
# r: viktor
import requests
import re
import scriptcontext as sc
import rhinoscriptsyntax as rs
import json
import viktor as vkt
import os

# Parse environment, workspace_id and entity_id from url
if not url.startswith("https://"):
    raise ValueError("url invalid")
pattern = re.compile(
    r"https://(?P<env>[a-z0-9\-]+\.?[a-z0-9]+)\.viktor\.ai/workspaces/?(?P<workspace>\d+)?(?:/app/editor/(?P<entity>\d+))?"
)
match = pattern.match(url).groupdict()
environment = match["env"]
workspace_id = int(match["workspace"]) if match["workspace"] else None
entity_id = int(match["entity"]) if match["entity"] else None

# Ask user for personal access token
if sc.sticky.has_key('viktor_token'):
    token = sc.sticky.get('viktor_token')
else:
    token = rs.StringBox('Fill in your Personal Access Token')
    sc.sticky['viktor_token'] = token


api = vkt.api_v1.API(token=token, environment=environment + ".viktor.ai")
entity = api.get_entity(entity_id, workspace_id=workspace_id)

result = entity.compute("results", params={'load': load, 'length': length, 'profile': profile})
uc = result['table']['data'][2][0]['value']
cost = result['table']['data'][3][0]['value']
embodied_carbon = result['table']['data'][5][0]['value']

print("UC =", uc)
print("Cost = $", cost)
print("Embodied carbon =", embodied_carbon, "kg CO2")
# ---------- end viktor_compute ----------
panel = Panel(viktor_compute)
