# Grasshopper definition grasshopper_viktor_get_data.gh (Grasshopper 1.0.8)
# plug-ins: RhinoCodePluginGH

get_data_from_viktor = Python3Script(url="https://demo.viktor.ai/workspaces/17/app/editor/2518")  # -> properties
# ---------- get_data_from_viktor: Python ----------
import requests
import re
import scriptcontext as sc
import rhinoscriptsyntax as rs
import json

# Parse environment, workspace_id and entity_id from url
if not url.startswith("https://"):
    raise ValueError("url invalid")
pattern = re.compile(
    r"https://(?P<env>[a-z0-9\-]+\.?[a-z0-9]+)\.viktor\.ai/workspaces/?(?P<workspace>\d+)?(?:/app/editor/(?P<entity>\d+))?"
)
match = pattern.match(url).groupdict()
environment = match["env"]
workspace_id = int(match["workspace"]) if match["workspace"] else None
entity_id = int(match["entity"]) if match["entity"] else None

# Ask user for personal access token
if sc.sticky.has_key('viktor_token'):
    token = sc.sticky.get('viktor_token')
else:
    token = rs.StringBox('Fill in your Personal Access Token')
    sc.sticky['viktor_token'] = token


# Sending a GET request with Bearer token to obtain the properties of a specific entity in your VIKTOR environment
response = requests.get(
  url=f"https://{environment}.viktor.ai/api/workspaces/{workspace_id}/entities/{entity_id}/", headers={'Authorization': f'Bearer {token}'}
)

# Check if authorization is correct, otherwise reset token
if response.status_code == 401:
    del sc.sticky['viktor_token']
    rs.MessageBox('Unauthorized: incorrect Personal Access Token', 1 | 16)
    raise ValueError('Unauthorized: incorrect Personal Access Token')

# Get properties
data = response.json()
properties = data['properties']

print(json.dumps(properties))
# ---------- end get_data_from_viktor ----------
panel = Panel(get_data_from_viktor)
convert_json = Python3Script(JSON=panel)  # -> out, width, length, thickness
# ---------- convert_json: Python ----------
import json

# Convert JSON string to dictionary
d = json.loads(JSON)

# Get output parameters from dictionary
width = d['bridge_layout']['width']
length = d['bridge_layout']['length']
thickness = d['bridge_layout']['deck_thickness']
# ---------- end convert_json ----------
box = CenterBox(Base=PlaneXY(0, 0, 0), X=convert_json.width, Y=convert_json.length, Z=convert_json.thickness)
