# Grasshopper definition grasshopper_viktor_push_data.gh (Grasshopper 1.0.8)
# plug-ins: RhinoCodePluginGH, LunchBox, Kangaroo2 Components

number_slider = Slider(10000, range=0..10000)
vec = VectorXYZ(XComponent=0, YComponent=0, ZComponent=0)  # -> Vector, Length

rectangle = Rectangle(Plane=vec.Vector, XSize=number_slider, YSize=number_slider, Radius=0)  # -> Rectangle, Length
division = Division(A=number_slider, B=3)
edges = BrepEdges(Brep=rectangle.Rectangle)  # -> flatten(Naked), Interior, NonManifold
Z = UnitZ(Factor=division)
midpt = CurveMiddle(Curve=edges.Naked)
end = EndPoints(Curve=edges.Naked)  # -> Start, End
move = Move(Geometry=midpt, Motion=Z)  # -> Geometry, Transform
number_slider_2 = Slider(10, range=0..10)
arc = Arc3Pt(PointA=end.Start, PointB=move.Geometry, PointC=end.End)  # -> Arc, Plane, Radius
patch = Patch(Curves=arc.Arc, Spans=20, Flexibility=1, Trim=True)
addition = Addition(A=number_slider_2, B=Slider(7, range=0..10))
hex = HexagonCells(Surface=patch, UDivisions=addition, VDivisions=number_slider_2, TParameter=0.25)  # -> HexagonCells, Centers

explode = Explode(Curve=hex.HexagonCells, Recursive=True)  # -> flatten(Segments), Vertices
dupln = RemoveDuplicateLines(Lines=explode.Segments, Tolerance=0.01)
len = Length(Curve=dupln)
int = Integer(len)
join = TextJoin(Text=int, Join=", ")
format_json = FormatJSON(curves=dupln, lengths=join)

mp = MultiPipe(Curves=dupln, NodeSize=Slider(123, range=0..1000), EndOffset=1, StrutSize=1, Segment=0, KinkAngle=0.6, CubeFit=0, Caps=0)

push_geometry_to_viktor = Python3Script(
    file_name="uploaded_lengths",
    url="https://demo.viktor.ai/workspaces/143/app/editor/8707",
    JSON=format_json,
    update=Button())
# ---------- push_geometry_to_viktor: Python ----------
import requests
import re
import scriptcontext as sc
import rhinoscriptsyntax as rs
import json
import datetime
from io import BytesIO

def _get_requests_authorization_header(token):
    return {'Authorization': 'Bearer ' + token}


def _get_requests_headers(token):
    headers = {
        'Content-Type': 'application/json',
        'User-Agent': 'viktor-revit-plugin/v0.0.1',
    }
    headers.update(_get_requests_authorization_header(token))
    return headers

_REQUEST_TIMEOUT = 10

def upload_file_to_s3(upload_url, upload_data, file):
    response = requests.post(
        upload_url, data=upload_data, timeout=_REQUEST_TIMEOUT, files={'file': file}
    )
    response.raise_for_status()
    return

class API:
    def __init__(self, environment, token):
        self.host = "https://" + environment + ".viktor.ai/api/"
        self._token = token
        self._session = requests.Session()
        self._session.headers = _get_requests_headers(token)

    def verify(self):
        url = self.host + "verify/"
        response = self._session.get(url, timeout=_REQUEST_TIMEOUT)
        if response.status_code == 401:
            raise ValueError("Cannot authenticate with VIKTOR. Please reset your Personal Access Token.")

    @classmethod
    def parse_resource_url(cls, resource_url):
        if not resource_url.startswith("https://"):
            raise ValueError("url invalid")
        pattern = re.compile(
            r"https://(?P<env>[a-z0-9\-]+\.?[a-z0-9]+)\.viktor\.ai/workspaces/?(?P<workspace>\d+)?(?:/app/editor/(?P<entity>\d+))?"
        )
        match = pattern.match(resource_url).groupdict()
        env = match["env"]
        workspace = int(match["workspace"]) if match["workspace"] else None
        entity = int(match["entity"]) if match["entity"] else None
        return env, workspace, entity

    def upload_file(self, workspace_id, entity_id, filename, file):
        # get upload information
        data = {"entity_id": entity_id, "filename": filename, "scope": "entity"}
        url = self.host + "workspaces/" + str(workspace_id) + "/files/"
        response = self._session.post(url, data=json.dumps(data), timeout=_REQUEST_TIMEOUT)
        if response.status_code == 401:
            raise ValueError("Cannot authenticate with VIKTOR. Please reset your Personal Access Token.")
        if response.status_code == 403:
            raise ValueError("You do not have access to this URL location. Please update the URL or ask an Admin.")
        response.raise_for_status()

        upload_url = response.json()['temp_upload_url']
        upload_data = response.json()['temp_upload_data']
        file_id = response.json()["id"]

        # upload file
        upload_file_to_s3(upload_url, upload_data, file)

        url = self.host + "workspaces/" + str(workspace_id) + "/files/"+  str(file_id) + "/uploaded/"
        response = self._session.post(url, data=data, timeout=_REQUEST_TIMEOUT)
        response.raise_for_status()

if update:
    # Parse environment, workspace_id and entity_id from url
    if not url.startswith("https://"):
        raise ValueError("url invalid")
    pattern = re.compile(
        r"https://(?P<env>[a-z0-9\-]+\.?[a-z0-9]+)\.viktor\.ai/workspaces/?(?P<workspace>\d+)?(?:/app/editor/(?P<entity>\d+))?"
    )
    match = pattern.match(url).groupdict()
    environment = match["env"]
    workspace_id = int(match["workspace"]) if match["workspace"] else None
    entity_id = int(match["entity"]) if match["entity"] else None
    # Ask user for personal access token
    if sc.sticky.has_key('viktor_token'):
        token = sc.sticky.get('viktor_token')
    else:
        token = rs.StringBox('Fill in your Personal Access Token')
        sc.sticky['viktor_token'] = token

    json_string = '{' + JSON + '}'
    json_bytes = json_string.encode('utf-8')
    bytes_io = BytesIO(json_bytes)

    api = API(environment, token)
    # Get the current time
    current_time = datetime.datetime.now()

    # Format the time as hours:minutes
    timestamp = current_time.strftime("%H:%M")
    generated_filename = file_name + "_" + timestamp + ".json"
    print(generated_filename)
    api.upload_file(workspace_id, entity_id, generated_filename, bytes_io)
    print('File successfully uploaded!')
# ---------- end push_geometry_to_viktor ----------

# ==== cluster FormatJSON
curves = ClusterInput()
lengths = ClusterInput()
end = EndPoints(Curves=curves)  # -> Start, End
format = Format(Format="\"start\":[{0}], \"end\":[{1}]", Culture=127, Data0=end.Start, Data1=end.End)
concat = Concatenate(FragmentA="{", FragmentB=format, FragmentC="}")
join = TextJoin(Text=concat, Join=",")
lengths_2 = Text(lengths)
format_2 = Format(Format="\"beams\":[{0}], \"lengths\":[{1}]", Culture=127, Data0=join, Data1=lengths_2)
T = ClusterOutput(format_2)
