# Grasshopper definition grasshopper_viktor_push_geometry.gh (Grasshopper 1.0.8)
# plug-ins: RhinoCodePluginGH

# ----
# Grid creator to use in LINK
amount_of_floors = Slider(20, range=0..20)
floor_height = Slider(2948, range=2500..4000)
spacing = Slider(4681, range=1500..5000)
amount_of_floors_2 = Number(amount_of_floors)
floor_height_2 = Number(floor_height)
size_x = Number(spacing)

number_of_columns_y = Slider(3, range=2..10)
number_of_columns_x = Slider(4, range=2..10)

series = Series(Start=0, Step=floor_height_2, Count=amount_of_floors_2)
recgrid = Rectangular(Plane=PlaneXY(0, 0, 0), SizeX=size_x, SizeY=size_x, ExtentX=number_of_columns_x, ExtentY=number_of_columns_y)  # -> Cells, Points
Z = UnitZ(Factor=series)
move = Move(Geometry=graft(recgrid.Points), Motion=Z)  # -> simplify(Geometry), Transform
move_2 = Move(Geometry=graft(recgrid.Cells), Motion=Z)  # -> simplify(Geometry), Transform
edges = BrepEdges(Brep=flatten(move_2.Geometry))  # -> flatten(Naked), Interior, NonManifold
uniquelines = UniqueLines(lines=edges.Naked)
all_points_per_floor = Point(move.Geometry)
all_points_per_floor_2 = Point(all_points_per_floor)
shift = ShiftList(List=all_points_per_floor_2, Shift=1, Wrap=False)
cull_i = CullIndex(List=all_points_per_floor_2, Indices=-1, Wrap=True)
ln = Line(StartPoint=cull_i, EndPoint=shift)  # -> flatten(Line)
columns = Line(ln)
beams = Line(uniquelines)

end = EndPoints(Curve=flatten([beams, columns]))  # -> Start, End
format = Format(Format="\"start\":[{0}], \"end\":[{1}]", Culture=127, Data0=end.Start, Data1=end.End)
concat = Concatenate(FragmentA="{", FragmentB=format, FragmentC="}")
join = TextJoin(Text=concat, Join=",")
format_2 = Format(Format="\"beams\":[{0}]", Culture=127, Data0=join)
beams_2 = Text(format_2)

push_model = Button()
push_geometry_to_viktor = Python3Script(
    file_name="grasshopper_building",
    url="https://demo.viktor.ai/workspaces/341/app/editor/8701",
    JSON=beams_2,
    update=push_model)
# ---------- push_geometry_to_viktor: Python ----------
import requests
import re
import scriptcontext as sc
import rhinoscriptsyntax as rs
import json
from io import BytesIO
from datetime import datetime

def _get_requests_authorization_header(token):
    return {'Authorization': 'Bearer ' + token}


def _get_requests_headers(token):
    headers = {
        'Content-Type': 'application/json',
        'User-Agent': 'viktor-revit-plugin/v0.0.1',
    }
    headers.update(_get_requests_authorization_header(token))
    return headers

_REQUEST_TIMEOUT = 10

def upload_file_to_s3(upload_url, upload_data, file):
    response = requests.post(
        upload_url, data=upload_data, timeout=_REQUEST_TIMEOUT, files={'file': file}
    )
    response.raise_for_status()
    return

class API:

    def __init__(self, environment, token):
        self.host = "https://" + environment + ".viktor.ai/api/"
        self._token = token
        self._session = requests.Session()
        self._session.headers = _get_requests_headers(token)

    def verify(self):
        url = self.host + "verify/"
        response = self._session.get(url, timeout=_REQUEST_TIMEOUT)
        if response.status_code == 401:
            raise ValueError("Cannot authenticate with VIKTOR. Please reset your Personal Access Token.")

    @classmethod
    def parse_resource_url(cls, resource_url):
        if not resource_url.startswith("https://"):
            raise ValueError("url invalid")
        pattern = re.compile(
            r"https://(?P<env>[a-z0-9\-]+\.?[a-z0-9]+)\.viktor\.ai/workspaces/?(?P<workspace>\d+)?(?:/app/editor/(?P<entity>\d+))?"
        )
        match = pattern.match(resource_url).groupdict()
        env = match["env"]
        workspace = int(match["workspace"]) if match["workspace"] else None
        entity = int(match["entity"]) if match["entity"] else None
        return env, workspace, entity

    def upload_file(self, workspace_id, entity_id, filename, file):
        # get upload information
        data = {"entity_id": entity_id, "filename": filename, "scope": "entity"}
        url = self.host + "workspaces/" + str(workspace_id) + "/files/"
        response = self._session.post(url, data=json.dumps(data), timeout=_REQUEST_TIMEOUT)
        if response.status_code == 401:
            raise ValueError("Cannot authenticate with VIKTOR. Please reset your Personal Access Token.")
        if response.status_code == 403:
            raise ValueError("You do not have access to this URL location. Please update the URL or ask an Admin.")
        response.raise_for_status()

        upload_url = response.json()['temp_upload_url']
        upload_data = response.json()['temp_upload_data']
        file_id = response.json()["id"]

        # upload file
        upload_file_to_s3(upload_url, upload_data, file)

        url = self.host + "workspaces/" + str(workspace_id) + "/files/"+  str(file_id) + "/uploaded/"
        response = self._session.post(url, data=data, timeout=_REQUEST_TIMEOUT)
        response.raise_for_status()

if update:
    # Parse environment, workspace_id and entity_id from url
    if not url.startswith("https://"):
        raise ValueError("url invalid")
    pattern = re.compile(
        r"https://(?P<env>[a-z0-9\-]+\.?[a-z0-9]+)\.viktor\.ai/workspaces/?(?P<workspace>\d+)?(?:/app/editor/(?P<entity>\d+))?"
    )
    match = pattern.match(url).groupdict()
    environment = match["env"]
    workspace_id = int(match["workspace"]) if match["workspace"] else None
    entity_id = int(match["entity"]) if match["entity"] else None

    # Ask user for personal access token
    if sc.sticky.has_key('viktor_token'):
        token = sc.sticky.get('viktor_token')
    else:
        token = rs.StringBox('Fill in your Personal Access Token')
        sc.sticky['viktor_token'] = token

    # Open and read the JSON file
    with open('C:/Users/sjansen/Desktop/beams_example.json', 'r') as file:
        data = json.load(file)

    json_string = "{"+ JSON + "}"
    json_bytes = json_string.encode('utf-8')
    bytes_io = BytesIO(json_bytes)

    # Add timestamp to file name
    current_time = datetime.now()
    timestamp_string = current_time.strftime("(%Y-%m-%d %H:%M:%S)")
    file_name = file_name + timestamp_string + ".json"

    api = API(environment, token)
    api.upload_file(workspace_id, entity_id, file_name, bytes_io)
    print('File successfully uploaded!')
# ---------- end push_geometry_to_viktor ----------

# ==== cluster UniqueLines
# Simple unique lines. Made complex to not use LunchBox/Kangaroo
lines = ClusterInput()
lines_2 = Line(lines)
midpt = CurveMiddle(Curve=lines_2)
cset = CreateSet(List=midpt)  # -> Set, Map
cset_2 = CreateSet(List=cset.Map)  # -> Set, Map
mindex = MemberIndex(Set=cset.Map, Member=cset_2.Set)  # -> Index, Count
item = ListItem(List=mindex.Index, Index=0, Wrap=True)  # -> flatten(Item)
item_2 = ListItem(List=lines_2, Index=item, Wrap=True)
uniquelines = Line(item_2)
geo = Geometry(item_2)
uniquelines_2 = ClusterOutput(uniquelines)
